# Grasshopper definition maka_baxis_calibration_G54_02_06_23.gh (Grasshopper 1.0.7)
# plug-ins: Raccoon

c_script = CSharpScript(
    tool_zero="55",
    z_safety="450",
    Reference="C:\Users\petra\AppData\Roaming\Grasshopper\Libraries\Raccoon\Raccoon_Library.dll")  # -> out; inputs tool_zero: Int32, z_safety: Double
# ---------- c_script: C# usings ----------
using Raccoon_Library;
# ---------- c_script: C# ----------
    // change the tool zero
    Raccoon_Library.GlobalParameters.zero_point = tool_zero;

    // change all existing z_safety values
    Raccoon_Library.GlobalParameters.z_safety = z_safety;
    Raccoon_Library.Axes.ZCoord = GlobalParameters.z_safety;
    Raccoon_Library.Axes.HomePosition2 = " X5000 Y-2000 Z" + GlobalParameters.z_safety.ToString();
    Raccoon_Library.Axes.HomePosition = " X0 Y0 Z" + GlobalParameters.z_safety.ToString();//" X5000 Y-2000 Z800";
# ---------- end c_script ----------
table = Maka()  # -> crv_2, brep_2
tools = Tools(Folder_and_File_Name_of_Tools="C:\Users\petra\AppData\Roaming\Grasshopper\Libraries\Raccoon\Tools.txt", Tolerance=0)

# ---- group: Milling
crv = Curve([<curve referenced from the Rhino model> x4])
milling = Milling(
    Plines=crv,
    Type=Slider(1, range=0..12),
    Notch=Slider(0, range=0..4),
    Radius=Slider(0, range=0..100),
    HeightInput=Slider(50, range=1..50),
    ToolID=Slider(75, range=0..150),
    Speed=Slider(20000, range=10000..40000),
    Zsec=Slider(650, range=0..800),
    Retreate=Slider(50, range=0..800),
    Angle=Slider(80, range=0..360))  # -> C0, C1, P, GCode

# ----
# Calibration from Two Sides
number_slider = Slider(10, range=-100..100)
panel = Panel("""0
90
180
270""")
panel_2 = Panel("""0
180""")
addition = Addition(A="111.113", B=panel_2, C=170)
addition_2 = Addition(A="111.113", B=panel)
table_2 = Maka()  # -> crv_2, brep_2
merge = Merge(BAxis=addition_2, GCode=milling.GCode, GCode_2=milling.GCode, GCode_3=milling.GCode, GCode_4=milling.GCode)
panel_3 = Panel(milling.GCode)

# ---- group: Open Polys
crv_2 = Curve([<curve referenced from the Rhino model> x2])
crv_3 = Curve([<curve referenced from the Rhino model> x2])
cluster = Cluster(G=crv_2, C=crv_3, B=number_slider)
open_polys = OpenPolys(
    Polyline=cluster,
    PolylineNormal=crv_3,
    ToolID=Slider(55, range=1..110),
    Speed=Slider(20000, range=1000..30000),
    Zsec=Slider(800, range=0..800),
    Retreate=Slider(70, range=0..300),
    Infeed=Slider(1, range=1..20),
    Angle=Slider(80, range=79..81))  # -> Info, GCode

crv_4 = Curve([<curve referenced from the Rhino model> x2])
crv_5 = Curve([<curve referenced from the Rhino model> x2])
cluster_2 = Cluster(G=crv_5, C=crv_4, B=number_slider)
open_polys_2 = OpenPolys(
    Polyline=cluster_2,
    PolylineNormal=crv_4,
    ToolID=Slider(55, range=1..110),
    Speed=Slider(20000, range=1000..30000),
    Zsec=Slider(800, range=0..800),
    Retreate=Slider(70, range=0..300),
    Infeed=Slider(1, range=1..20),
    Angle=Slider(80, range=79..81))  # -> Info, GCode

# ----
merge_2 = Merge(BAxis=addition, GCode=open_polys.GCode, GCode_2=open_polys_2.GCode)

# ---- group: Simulate
simulate = Simulate(GCode=merge_2, Position=Slider(1, range=0..1))  # -> Tool, GCode

simulate_2 = Simulate(GCode=merge, Position=Slider(0.1585, range=0..1))  # -> Tool, GCode

# ----
number_slider_2 = Slider(5, range=0..100)
crv_6 = Curve([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])
Z = UnitZ(Factor=1)

# ----
# Drilling From Two Sides
baxis = BAxis(<baxis referenced from the Rhino model>)
crv_7 = Curve([<curve referenced from the Rhino model> x2])

pframe = PerpFrame(Curve=baxis, Parameter=0)
ext = ExtendCurve(Curve=crv_7, Type=0, Start=number_slider_2, End=number_slider_2)
align = AlignPlane(Plane=pframe, Direction=Z)  # -> Plane, Angle
line = Line(ext)
c_script_2 = CSharpScript(lines=line, target_plane=align.Plane)  # -> out, angles_lines, rotated_lines, angles_polylines, rotated_polylines; inputs lines: list of Line, polylines: list of Polyline, target_plane: Plane
# ---------- c_script_2: C# ----------
    var angles_lines = new List<double>();
    var angles_polylines = new List<double>();
    var rotated_lines = new List<Line>();
    var rotated_polylines = new List<Polyline>();

    for(int i = 0; i < lines.Count; i++){
      double angle = Vector3d.VectorAngle(lines[i].Direction, -Vector3d.XAxis, Plane.WorldXY);
      Line line_copy = lines[i];
      Transform xform = Transform.Rotation(angle, Point3d.Origin);
      Transform xform_orient = Transform.PlaneToPlane(Plane.WorldXY, target_plane);
      line_copy.Transform(xform_orient * xform);
      angles_lines.Add((double) Math.Round(Rhino.RhinoMath.ToDegrees(angle), 3));
      rotated_lines.Add(line_copy);

    }

    var angles_lines__ = new List<double>();
    for(int i = 0; i < angles_lines.Count;i++ ){
      double angle = 0*90 + (angles_lines[i] - angles_lines[0]);
      if(angle < 0)
        angle = 360 + angle;
      angles_lines__.Add(angle);

      //angles_lines[i] += 90;
    }

    angles_lines_ = angles_lines__;
    angles_polylines_ = angles_polylines;
    rotated_lines_ = rotated_lines;
    rotated_polylines_ = rotated_polylines;
# ---------- end c_script_2 ----------

# ---- group: Drilling
crv_8 = Curve(graft(c_script_2.rotated_lines))
drill_holes = Drilling(
    Lines=crv_8,
    ToolID=Slider(75, range=1..140),
    Speed=Slider(20000, range=1000..30000),
    Zsec=Slider(650, range=0..750),
    Retreate=Slider(72, range=0..300),
    Infeed=Slider(1, range=1..20),
    Vertical=Toggle(False))  # -> Info, GCode

# ---- group: Circle Holes
crv_9 = Curve(graft(c_script_2.rotated_lines))
circle_holes = CircleHoles(
    Line=crv_9,
    Radius=Slider(25.4, range=1..100),
    Scale=Slider(0.38, range=0.01..2),
    Turns=Slider(20, range=1..20),
    ToolID=Slider(75, range=1..110),
    Speed=Slider(13000, range=1000..30000),
    Zsec=Slider(650, range=0..650),
    Retreate=Slider(40, range=0..300),
    Infeed=Slider(1, range=1..20),
    Angle=Slider(80, range=79..81))  # -> Info, GCode

# ----
addition_3 = Addition(A=c_script_2.angles_lines, B="111.113", C=Slider(90, range=0..100))
merge_3 = Merge(BAxis=addition_3, GCode=circle_holes.GCode)

# ---- group: Simulate
simulate_3 = Simulate(GCode=merge_3, Position=Slider(1, range=0..1))  # -> Tool, GCode

# ==== cluster Cluster
C = ClusterInput()
G = ClusterInput()
midpt = CurveMiddle(Curve=C)
midpt_2 = CurveMiddle(Curve=G)
vec2pt = Vector2Pt(PointA=midpt, PointB=midpt_2, Unitize=invert(False))  # -> Vector, Length
B = ClusterInput()
multiplication = Multiplication(A=vec2pt.Vector, B=B)
move = Move(Geometry=G, Motion=multiplication)  # -> Geometry, Transform
G_2 = ClusterOutput(move.Geometry)

# ==== cluster Maka: Maka table
crv = Curve([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])
brep = Brep(<brep referenced from the Rhino model>)
crv_2 = ClusterOutput(crv)
brep_2 = ClusterOutput(brep)
