# Grasshopper definition Raccoon_BAxis.gh (Grasshopper 1.0.7)
# plug-ins: Raccoon

baxis = BAxis(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)
crv = Curve([<curve referenced from the Rhino model> x4])
c_script = CSharpScript(
    line=baxis,
    offset="800",
    Reference="C:\USERS\PETRAS\APPDATA\ROAMING\MCNEEL\RHINOCEROS\PACKAGES\7.0\NGON\3.2.0\NGonsCore.dll")  # -> out, plane; inputs line: Line, offset: Double
# ---------- c_script: C# usings ----------
using NGonsCore;
# ---------- c_script: C# ----------
    Point3d p = _line.From;
    Vector3d dir = _line.Direction;
    dir.Unitize();
    dir *= _offset;
    Plane plane = new Plane(p + dir, _line.Direction);
    __plane = PlaneUtil.AlignPlane(plane, Vector3d.ZAxis);
# ---------- end c_script ----------

path = FilePath("C:\Users\petras\AppData\Roaming\Grasshopper\Libraries\Raccoon\Tools.txt")
tools = Tools(Folder_and_File_Name_of_Tools=path, Tolerance=0)
panel = Panel("""75 - Mill
140 Small Mill
26 - Drill""")
table = Maka()  # -> crv_2, brep_2
c_script_2 = CSharpScript(
    tool_zero="55",
    z_safety="650",
    Reference="C:\Users\petras\AppData\Roaming\Grasshopper\Libraries\Raccoon\Raccoon_Library.dll")  # -> out; inputs tool_zero: Int32, z_safety: Double
# ---------- c_script_2: C# usings ----------
using Raccoon_Library;
# ---------- c_script_2: C# ----------
    // change the tool zero
    Raccoon_Library.GlobalParameters.zero_point = tool_zero;

    // change all existing z_safety values
    Raccoon_Library.GlobalParameters.z_safety = z_safety;
    Raccoon_Library.Axes.ZCoord = GlobalParameters.z_safety;
    Raccoon_Library.Axes.HomePosition2 = " X5000 Y-2000 Z" + GlobalParameters.z_safety.ToString();
    Raccoon_Library.Axes.HomePosition = " X0 Y0 Z" + GlobalParameters.z_safety.ToString();//" X5000 Y-2000 Z800";
# ---------- end c_script_2 ----------

partition = PartitionList(List=crv, Size=Slider(2, range=0..10))
c_script_3 = CSharpScript(polylines=partition, target_plane=c_script.plane)  # -> out, angles_lines, rotated_lines, angles_polylines, rotated_polylines; inputs lines: list of Line, polylines: list of Polyline, target_plane: Plane
# ---------- c_script_3: C# ----------
    var angles_lines = new List<double>();
    var angles_polylines = new List<double>();
    var rotated_lines = new List<Line>();
    var rotated_polylines = new List<Polyline>();

    ////////////////////////////////////////////////////////////////////////////////////////////////////////
    // Lines
    ////////////////////////////////////////////////////////////////////////////////////////////////////////
    for(int i = 0; i < lines.Count; i++){
      double angle = Vector3d.VectorAngle(lines[i].Direction, -Vector3d.XAxis, Plane.WorldXY);
      Line line_copy = lines[i];
      Transform xform = Transform.Rotation(angle, Point3d.Origin);
      Transform xform_orient = Transform.PlaneToPlane(Plane.WorldXY, target_plane);
      line_copy.Transform(xform_orient * xform);
      angles_lines.Add(-(double) Math.Round(Rhino.RhinoMath.ToDegrees(angle), 3));
      rotated_lines.Add(line_copy);
    }

    var angles_lines__ = new List<double>();
    for(int i = 0; i < angles_lines.Count;i++ ){
      double angle = 0 * 90 + (angles_lines[i]);// - angles_lines[0]
      if(angle < 0)
        angle = 360 + angle;
      angles_lines__.Add(angle + 0 * ( -111.113));
    }

    ////////////////////////////////////////////////////////////////////////////////////////////////////////
    // Polylines
    ////////////////////////////////////////////////////////////////////////////////////////////////////////

    for(int i = 0; i < polylines.Count; i += 2){
      Line line = new Line(polylines[i + 1][0], polylines[i + 0][0]);
      double angle = Vector3d.VectorAngle(line.Direction, -Vector3d.XAxis, Plane.WorldXY);
      Polyline[] plines = new Polyline[2]{new Polyline(polylines[i]),new Polyline(polylines[i + 1])};

      Transform xform = Transform.Rotation(angle, Point3d.Origin);
      Transform xform_orient = Transform.PlaneToPlane(Plane.WorldXY, target_plane);
      for (int j = 0; j < 2; j++)
      {
        plines[j].Transform(xform_orient * xform);
        rotated_polylines.Add(plines[j]);
      }
      angles_polylines.Add(-(double) Math.Round(Rhino.RhinoMath.ToDegrees(angle), 3));
    }

    var angles_polylines__ = new List<double>();
    for(int i = 0; i < angles_polylines.Count;i++ ){
      Print(angles_polylines[0].ToString());
      double angle = 0 * 90 + angles_polylines[i]; //(angles_polylines[i] - angles_polylines[0]); - angles_polylines[0]
      if(angle < 0)
        angle = 360 + angle;
      angles_polylines__.Add(angle + 0 * ( -111.113));
    }


    ////////////////////////////////////////////////////////////////////////////////////////////////////////
    //output
    ////////////////////////////////////////////////////////////////////////////////////////////////////////
    angles_lines_ = angles_lines__;
    angles_polylines_ = angles_polylines__;
    rotated_lines_ = rotated_lines;
    rotated_polylines_ = rotated_polylines;
# ---------- end c_script_3 ----------
item = ListItem(List=c_script_3.rotated_polylines, Index=0, Wrap=True)  # -> Item, Item1

# ---- group: Milling
crv_2 = Curve(c_script_3.rotated_polylines)
partition_2 = PartitionList(List=crv_2, Size=2)
milling = Milling(
    Plines=partition_2,
    Type=Slider(1, range=0..12),
    Notch=Slider(0, range=0..4),
    Radius=Slider(0, range=0..100),
    HeightInput=Slider(20, range=1..80),
    ToolID=Slider(74, range=0..150),
    Speed=Slider(5000, range=3000..30000),
    Zsec=Slider(650, range=0..800),
    Retreate=Slider(50, range=0..800),
    Angle=Slider(80, range=0..360))  # -> C0, C1, P, simplify(GCode)
c_script_4 = CSharpScript(x=milling.GCode)  # -> A; inputs x: list of String
# ---------- c_script_4: C# ----------
    if(x[11] == "N110 (____________start_cutting____________)" && x[12] == "N120 (____________end_drilling____________)"){
      A = new string[0];
    }else{
      A = x;
    }
# ---------- end c_script_4 ----------

# ---- group: SawBlade
crv_3 = Curve(item.Item)
crv_4 = Curve(item.Item1)
sawblade = SawBlade(
    Cut_polyline=crv_3,
    Dir_polyline=crv_4,
    Cut_type=Slider(3, range=0..12),
    Radius=Slider(0, range=0..200),
    DivisionsU=Slider(78, range=0..400),
    DivisionsV=Slider(0, range=0..10),
    Cut90Degrees=Slider(1, range=0..1),
    RetreateO=Slider(80, range=0..800),
    RetreateZ=Slider(650, range=0..800),
    Extend=Slider(1, range=0..2),
    ToolID=Slider(21, range=0..200),
    Speed=Slider(7000, range=5000..20000),
    Zsec=Slider(700, range=0..800),
    Retreate=Slider(200, range=0..800))  # -> C0, C1, Planes, GCode

# ----
c_script_5 = CSharpScript(x=sawblade.GCode)  # -> A; inputs x: list of String; same code as c_script_4
merge = Merge(Data1=simplify(flatten(c_script_3.angles_polylines)), Data2=simplify(flatten(c_script_3.angles_polylines)))
entwine = Entwine(Branch0X=simplify(c_script_4), Branch1X=simplify(c_script_5), FlattenInputs=False)
merge_2 = Merge(BAxis=merge, GCode=entwine)
simulatecardan = SimulateCardan(GCode=merge_2, Position=Slider(0.954141, range=0..1))  # -> Tool, GCode

# ==== cluster Maka: Maka table
crv = Curve([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])
brep = Brep(<brep referenced from the Rhino model>)
crv_2 = ClusterOutput(crv)
brep_2 = ClusterOutput(brep)
